# Grasshopper definition assignment-01.gh (Grasshopper 1.0.8)

# ---- group: Auto-reloads cdf module on VScode changes
# Setting path for Src AutoReloader: 1. Right click on Path
# 2. Choose "Select a directory"
# 3. Locate the ..\cdf1_teaching\src folder in your computer
# Assignment-01: Bauhaus
path = FilePath("C:\Users\gumbe\workspace\cdf1_teaching\cdf1_teaching\src\")
autoreloader = Python3Script(src_path=path)  # -> out; inputs src_path: String
# ---------- autoreloader: Python ----------
#! python3
import sys, os, time
import scriptcontext as sc
import Rhino, System
from System.IO import FileSystemWatcher, NotifyFilters

VERSION = 1  
pkg = "cdf"

if not src_path:
    raise Exception("Connect a folder to src_path.")
path = os.path.normpath(src_path)
watch_dir = os.path.join(path, pkg)
if not os.path.isdir(watch_dir):
    raise Exception("No '{}' folder found in:\n{}".format(pkg, path))

def unload():
    for name in list(sys.modules):
        if name == pkg or name.startswith(pkg + "."):
            del sys.modules[name]

# Put this folder first in Python's search list
if path in sys.path:
    sys.path.remove(path)
sys.path.insert(0, path)

key = "cdf_watcher_" + str(ghenv.Component.InstanceGuid)
time_key = key + "_time"
version_key = key + "_version"

def stamp():
    sc.sticky[time_key] = time.strftime("%Y-%m-%d %H:%M:%S")

# Replace the old watcher if the folder changed or the script was updated
old = sc.sticky.get(key)
if old is not None and (os.path.normpath(old.Path) != watch_dir
                        or sc.sticky.get(version_key) != VERSION):
    old.Dispose()
    del sc.sticky[key]
    unload()

if key not in sc.sticky:
    comp = ghenv.Component
    last = [0.0]

    def reload_and_rerun():
        unload()
        stamp()
        doc = comp.OnPingDocument()
        if doc is None:            # reloader was deleted or the file closed
            return
        for obj in doc.Objects:
            if "Python" in obj.GetType().Name:
                obj.ExpireSolution(False)   # mark as out of date
        doc.NewSolution(False)              # recompute once

    def on_change(sender, e):
        if not e.FullPath.endswith(".py") or "__pycache__" in e.FullPath:
            return
        if time.time() - last[0] < 0.5:     # ignore the second event of a double save
            return
        last[0] = time.time()
        Rhino.RhinoApp.InvokeOnUiThread(System.Action(reload_and_rerun))

    w = FileSystemWatcher(watch_dir, "*.py")
    w.IncludeSubdirectories = True
    w.NotifyFilter = NotifyFilters.LastWrite
    w.Changed += on_change
    w.EnableRaisingEvents = True
    sc.sticky[key] = w
    sc.sticky[version_key] = VERSION
    stamp()                                  # time the watcher started

msg = "Last reloaded: {}\nWatching: {}".format(sc.sticky.get(time_key, "unknown"), watch_dir)
print(msg)
out = msg
# ---------- end autoreloader ----------
panel = Panel(autoreloader)

# ----
number_slider = Slider(1, range=0..2)
number_slider_2 = Slider(41, range=10..60)
number_slider_3 = Slider(30, range=10..60)
container_type = Python3Script(container_type=number_slider, size=number_slider_2, height=number_slider_3)  # -> out, a
# ---------- container_type: Python ----------
# import function
from cdf import create_container

# call function
a = create_container(container_type=container_type, size=size, height=height)
# ---------- end container_type ----------
gravity_spheres = Python3Script(
    container_type=number_slider,
    size=number_slider_2,
    height=number_slider_3,
    count=Slider(43, range=5..100),
    seed=Slider(19, range=0..50))  # -> a, b, c
# ---------- gravity_spheres: Python ----------
from cdf import pack_gravity_spheres

planes, radii = pack_gravity_spheres(
    container_type=container_type,
    size=size,
    height=height,
    count=count,
    min_radius=2.0,
    max_radius=5.0,
    seed=seed
)

a = planes
b = radii

outside = []
half = 30.0 / 2.0

for i, (plane, radius) in enumerate(zip(planes, radii)):
    point = plane.Origin
    if (abs(point.X) + radius > half + 1e-6
            or abs(point.Y) + radius > half + 1e-6
            or point.Z < radius - 1e-6
            or point.Z > 30.0 - radius + 1e-6):
        outside.append((i, point, radius))

c = outside
# ---------- end gravity_spheres ----------
sphere = Sphere(Base=gravity_spheres.a, Radius=gravity_spheres.b)
python_3_script = Python3Script(planes=gravity_spheres.a, radii=gravity_spheres.b)  # -> out, a; inputs planes: list, radii: list
# ---------- python_3_script: Python ----------
from cdf import populate_shapes

shapes = populate_shapes(planes, radii)
a = shapes
# ---------- end python_3_script ----------
